# Grasshopper definition rnd_node.gh (Grasshopper 1.0.7)

# ---- group: RH_IN:radius
radius = Slider(41, range=0..100)

# ---- group: RH_IN:segments
segments = Slider(9, range=0..10)

# ----
height = Slider(25, range=0..100)

# ---- group: RH_IN:count
count = Slider(228, range=0..360)

# ----
construct_domain = ConstructDomain(DomainStart=0, DomainEnd=count)
series = Series(Start="0", Step=height, Count=10)
polygon = Polygon(Plane=PlaneXY(0, 0, 0), Radius=radius, Segments=segments, FilletRadius=0)  # -> Polygon, Length
unit_z = UnitZ(Factor=series)
move = Move(Geometry=polygon.Polygon, Motion=unit_z)  # -> Geometry, Transform
curve = Curve(move.Geometry)
list_length = ListLength(List=curve)
subtraction = Subtraction(A=list_length, B="1")
range = Range(Domain=construct_domain, Steps=subtraction)
radians = Radians(Degrees=range)
rotate = Rotate(Geometry=curve, Angle=radians, Plane=PlaneXY(0, 0, 0))  # -> Geometry, Transform
curve_2 = Curve(rotate.Geometry)
loft = Loft(Curves=curve_2, Options={Adjust=False, Closed=False, LoftEnds=0, LoftSimp=0, LoftType=0, Rebuild=10, Refit=0.01})
medges = MeshEdges(Mesh=loft)  # -> NakedEdges, InteriorEdges, NonManifoldEdges

# ---- group: RH_OUT:edges
crv = Curve([medges.InteriorEdges, medges.NakedEdges])

# ---- group: RH_OUT:mesh
mesh = Mesh(loft)
